# Dynamo graph LAC_Cotas_Gerais.dyn (Dynamo 4.0.2.3852)
# Cotas gerais e encadeadas com referências nativas de paredes.

executar = BoolSelector(false)  # graph input
LAC_Cotas_Gerais = Python(IN[0]=executar)  # PythonNet3; graph output
# ---------- LAC_Cotas_Gerais.python (477 lines) ----------
"""Shared Dynamo PythonNet3 adapter; embedded in each graph at build time."""
import math
import clr
clr.AddReference('RevitAPI')
clr.AddReference('RevitAPIUI')
clr.AddReference('RevitServices')
clr.AddReference('System.Windows.Forms')
clr.AddReference('System.Drawing')
from Autodesk.Revit import DB
from Autodesk.Revit.UI.Selection import ObjectType
from Autodesk.Revit.Exceptions import OperationCanceledException
from RevitServices.Persistence import DocumentManager
from RevitServices.Transactions import TransactionManager
from System.Windows import Forms as WF
from System.Drawing import Size, Point

doc=DocumentManager.Instance.CurrentDBDocument
uidoc=DocumentManager.Instance.CurrentUIApplication.ActiveUIDocument
view=doc.ActiveView
FT=.3048


def name_of(element):
    try:return element.Name
    except Exception:
        p=element.get_Parameter(DB.BuiltInParameter.SYMBOL_NAME_PARAM)
        return p.AsString() if p else str(element.Id.Value)


def configure(title, fields):
    form=WF.Form();form.Text=title;form.Width=620;form.Height=155+len(fields)*50
    form.StartPosition=WF.FormStartPosition.CenterScreen;form.TopMost=True
    form.FormBorderStyle=WF.FormBorderStyle.FixedDialog;form.MaximizeBox=False;form.MinimizeBox=False
    controls={}
    for index,(key,label,values,default) in enumerate(fields):
        text=WF.Label();text.Text=label;text.Location=Point(12,15+index*50);text.Size=Size(575,18)
        control=WF.ComboBox() if values is not None else WF.TextBox()
        control.Location=Point(12,34+index*50);control.Size=Size(575,25)
        if values is not None:
            control.DropDownStyle=WF.ComboBoxStyle.DropDownList
            for value in values:control.Items.Add(str(value))
            control.SelectedIndex=values.index(default) if default in values else 0
        else:control.Text=str(default)
        controls[key]=control;form.Controls.Add(text);form.Controls.Add(control)
    ok=WF.Button();ok.Text='Continuar';ok.DialogResult=WF.DialogResult.OK;ok.Location=Point(370,65+len(fields)*50)
    cancel=WF.Button();cancel.Text='Cancelar';cancel.DialogResult=WF.DialogResult.Cancel;cancel.Location=Point(475,65+len(fields)*50)
    form.Controls.Add(ok);form.Controls.Add(cancel);form.AcceptButton=ok;form.CancelButton=cancel
    try:
        if form.ShowDialog()!=WF.DialogResult.OK:raise OperationCanceledException()
        return {key:control.Text for key,control in controls.items()}
    finally:form.Dispose()


def number(text, low, high):
    value=float(text.replace(',','.'))
    if not math.isfinite(value) or not low<=value<=high:raise ValueError('Valor fora de {} a {}.'.format(low,high))
    return value


def source_options():
    result={'Projeto atual':None}
    for link in DB.FilteredElementCollector(doc).OfClass(DB.RevitLinkInstance):
        if link.GetLinkDocument() is not None and not link.IsHidden(view):
            result['{} [{}]'.format(name_of(link),link.Id.Value)]=link
    return result


def collect(source, link, category=None, klass=None):
    collector=DB.FilteredElementCollector(doc,view.Id,link.Id) if link else DB.FilteredElementCollector(doc,view.Id)
    if category is not None:collector=collector.OfCategory(category)
    if klass is not None:collector=collector.OfClass(klass)
    return list(collector.WhereElementIsNotElementType())


def require_plan():
    if doc.IsFamilyDocument or not isinstance(view,DB.ViewPlan) or view.IsTemplate or not view.GenLevel:
        raise ValueError('Abra uma planta de pavimento com nível associado.')
    if abs(view.ViewDirection.Z)<.999999:raise ValueError('Somente plantas horizontais são suportadas.')
    # End any idle Dynamo-managed transaction before native rollback groups.
    TransactionManager.Instance.ForceCloseTransaction()


def within_crop(a,b):
    if not view.CropBoxActive:return True
    box=view.CropBox
    for p in (a,b):
        local=box.Transform.Inverse.OfPoint(p)
        if not (box.Min.X<=local.X<=box.Max.X and box.Min.Y<=local.Y<=box.Max.Y):return False
    return True


def finish(message):
    WF.MessageBox.Show(message,'LAC · Dynamo')


def guarded(callback):
    try:
        require_plan()
        return callback()
    except OperationCanceledException:return {'status':'Cancelado pelo usuário; nenhuma operação pendente.'}
    except Exception as error:
        finish(str(error))
        return {'status':'Erro','mensagem':str(error)}

import types
ALIGNMENT=.999999
revit=types.SimpleNamespace(doc=doc)
def faces_of(wall, view):
    options = DB.Options()
    options.ComputeReferences = True
    options.IncludeNonVisibleObjects = False
    native_view = getattr(view, 'native_view', view)
    if native_view is not None:
        options.View = native_view
    else:
        options.DetailLevel = DB.ViewDetailLevel.Fine
    faces = []
    for geometry in wall.get_Geometry(options):
        if isinstance(geometry, DB.Solid):
            for face in geometry.Faces:
                if isinstance(face, DB.PlanarFace) and face.Reference:
                    faces.append(face)
    return faces

def edges_of(wall, view):
    options = DB.Options()
    options.ComputeReferences = True
    options.IncludeNonVisibleObjects = False
    native_view = getattr(view, 'native_view', view)
    if native_view is not None:
        options.View = native_view
    else:
        options.DetailLevel = DB.ViewDetailLevel.Fine
    edges = []
    for geometry in wall.get_Geometry(options):
        if isinstance(geometry, DB.Solid):
            edges.extend(list(geometry.Edges))
    return edges

def endpoint_candidates(wall, view, curve, start, end, direction, faces):
    alternatives = []
    doc = getattr(wall, 'Document', revit.doc)

    def valid(ref):
        if ref is None:
            return False
        try:
            if ref.ElementId != wall.Id:
                return False
            return bool(ref.ConvertToStableRepresentation(doc))
        except Exception:
            return False
    try:
        refs = [curve.GetEndPointReference(0), curve.GetEndPointReference(1)]
        if all((valid(r) for r in refs)) and reference_key(doc, refs)[0] != reference_key(doc, refs)[1]:
            alternatives.append((refs, project_to_view(start, view), project_to_view(end, view)))
    except Exception:
        pass
    ends = [[], []]
    near = max(wall.Width * 2, 0.01)
    span = end.Subtract(start).DotProduct(direction)

    def add(ref, point):
        if not valid(ref):
            return
        t = point.Subtract(start).DotProduct(direction)
        for index, target in enumerate((0, span)):
            if abs(t - target) <= near and abs(t - target) < span / 2:
                projected = project_to_view(start, view).Add(direction.Multiply(t))
                ends[index].append((abs(t - target), ref, projected))
    for face in faces:
        if abs(face.FaceNormal.DotProduct(direction)) >= ALIGNMENT:
            add(face.Reference, face.Origin)
    try:
        edges = edges_of(wall, view)
    except Exception:
        edges = []
    for edge in edges:
        try:
            c = edge.AsCurve()
            if not isinstance(c, DB.Line):
                continue
            a, b = (c.GetEndPoint(0), c.GetEndPoint(1))
            axis = b.Subtract(a).Normalize()
            if abs(axis.DotProduct(view.ViewDirection)) >= ALIGNMENT:
                add(edge.Reference, a)
            for index, point in enumerate((a, b)):
                try:
                    add(c.GetEndPointReference(index), point)
                except Exception:
                    pass
        except Exception:
            pass
    for candidates in ends:
        candidates.sort(key=lambda x: x[0])
    seen = set((reference_key(doc, a[0]) for a in alternatives))
    for first in ends[0][:6]:
        for last in ends[1][:6]:
            refs = [first[1], last[1]]
            key = reference_key(doc, refs)
            if key in seen or key[0] == key[1]:
                continue
            if last[2].Subtract(first[2]).DotProduct(direction) <= 0.0001:
                continue
            seen.add(key)
            alternatives.append((refs, first[2], last[2]))
    return alternatives[:20]

def reference_key(doc, refs):
    return tuple(sorted((r.ConvertToStableRepresentation(doc) for r in refs)))

def rectangle(points, view, padding):
    xs = [p.DotProduct(view.RightDirection) for p in points]
    ys = [p.DotProduct(view.UpDirection) for p in points]
    return (min(xs) - padding, min(ys) - padding, max(xs) + padding, max(ys) + padding)

def polygon_of_box(box):
    return [(box[0], box[1]), (box[2], box[1]), (box[2], box[3]), (box[0], box[3])]

def overlaps(a, b):
    for polygon in (a, b):
        for i, p in enumerate(polygon):
            q = polygon[(i + 1) % len(polygon)]
            axis = (p[1] - q[1], q[0] - p[0])
            if abs(axis[0]) + abs(axis[1]) < 1e-06:
                continue
            x = [point[0] * axis[0] + point[1] * axis[1] for point in a]
            y = [point[0] * axis[0] + point[1] * axis[1] for point in b]
            if max(x) <= min(y) or max(y) <= min(x):
                return False
    return True

def wall_footprint(wall, view):
    if isinstance(wall.Location, DB.LocationCurve) and isinstance(wall.Location.Curve, DB.Line):
        curve = wall.Location.Curve
        a, b = (curve.GetEndPoint(0), curve.GetEndPoint(1))
        n = view.ViewDirection.CrossProduct(b.Subtract(a).Normalize()).Normalize().Multiply(wall.Width / 2)
        points = [a.Add(n), b.Add(n), b.Subtract(n), a.Subtract(n)]
        return [(p.DotProduct(view.RightDirection), p.DotProduct(view.UpDirection)) for p in points]
    return None

def box_rectangle(box, view):
    points = [box.Transform.OfPoint(DB.XYZ(x, y, z)) for x in (box.Min.X, box.Max.X) for y in (box.Min.Y, box.Max.Y) for z in (box.Min.Z, box.Max.Z)]
    return rectangle(points, view, 0)

def project_to_view(point, view):
    return point.Subtract(view.ViewDirection.Multiply(point.Subtract(view.Origin).DotProduct(view.ViewDirection)))

def dimension_specs(wall, view, mode, offset):
    location = wall.Location
    if not isinstance(location, DB.LocationCurve) or not isinstance(location.Curve, DB.Line):
        raise ValueError('Parede curva ou sem eixo reto: nao suportada.')
    curve = location.Curve
    start, end = (curve.GetEndPoint(0), curve.GetEndPoint(1))
    direction = end.Subtract(start).Normalize()
    if abs(direction.DotProduct(view.ViewDirection)) > 1e-06:
        raise ValueError('Eixo fora do plano da vista ativa.')
    normal = view.ViewDirection.CrossProduct(direction).Normalize()
    if normal.DotProduct(wall.Orientation) < 0:
        normal = normal.Negate()
    faces = faces_of(wall, view)
    specs, errors = ([], [])
    if mode != 'Espessura':
        alternatives = endpoint_candidates(wall, view, curve, start, end, direction, faces)
        if not alternatives:
            errors.append('Comprimento: eixo sem referencias nativas e nenhuma face/aresta referenciavel proxima das extremidades na vista.')
        for refs, p, q in alternatives:
            specs.append(('comprimento', refs, p, q, normal, wall.Width / 2 + offset))
    if mode != 'Comprimento':
        try:
            valid = {f.Reference.ConvertToStableRepresentation(getattr(wall, 'Document', revit.doc)) for f in faces}
            sides = []
            for side in (DB.ShellLayerType.Interior, DB.ShellLayerType.Exterior):
                candidates = []
                for ref in DB.HostObjectUtils.GetSideFaces(wall, side):
                    face = wall.GetGeometryObjectFromReference(ref)
                    if isinstance(face, DB.PlanarFace) and abs(face.FaceNormal.DotProduct(normal)) >= ALIGNMENT and (ref.ConvertToStableRepresentation(getattr(wall, 'Document', revit.doc)) in valid):
                        candidates.append((face, ref))
                if not candidates:
                    raise ValueError('Face de acabamento sem referencia valida na vista.')
                sides.append(max(candidates, key=lambda pair: pair[0].Area))
            a, b = [pair[0].Origin.DotProduct(normal) for pair in sides]
            if abs(b - a) < 0.0001:
                raise ValueError('Faces coincidentes.')
            base = project_to_view(start, view)
            p = base.Add(normal.Multiply(a - start.DotProduct(normal)))
            q = base.Add(normal.Multiply(b - start.DotProduct(normal)))
            specs.append(('espessura', [pair[1] for pair in sides], p, q, direction.Negate(), offset))
        except Exception as error:
            errors.append('Espessura: {0}'.format(error))
    return (specs, errors)
"""General and chained native dimensions, using LAC's existing reference search."""
def dimension_main():
    sources=source_options()
    dimension_types={'Padrão do Revit':None}
    for kind in DB.FilteredElementCollector(doc).OfClass(DB.DimensionType):
        if kind.StyleType==DB.DimensionStyleType.Linear:
            dimension_types['{} [{}]'.format(name_of(kind),kind.Id.Value)]=kind
    config=configure('Cotas gerais automáticas',[
        ('source','Origem das paredes',list(sources),'Projeto atual'),
        ('scope','Paredes a cotar',['Todas as paredes visíveis','Selecionar paredes'],'Todas as paredes visíveis'),
        ('mode','Composição',['Todas as paredes','Externas + trechos principais'],'Todas as paredes'),
        ('minimum','Trecho principal mínimo (m), para a segunda opção',None,'1,00'),
        ('style','Tipo de cota',list(dimension_types),'Padrão do Revit'),
        ('offset','Afastamento no papel (mm)',None,'8'),
    ])
    link=sources[config['source']];source=link.GetLinkDocument() if link else doc
    transform=link.GetTotalTransform() if link else DB.Transform.Identity
    walls=collect(source,link,klass=DB.Wall)
    if config['scope']=='Selecionar paredes':
        references=uidoc.Selection.PickObjects(ObjectType.LinkedElement if link else ObjectType.Element,'Selecione as paredes e conclua a seleção')
        selected={int(r.LinkedElementId.Value if link else r.ElementId.Value) for r in references if not link or r.ElementId==link.Id}
        walls=[w for w in walls if int(w.Id.Value) in selected]
    if len(walls)<2:raise ValueError('Selecione pelo menos duas paredes visíveis da origem escolhida.')
    offset=number(config['offset'],3,50)/1000*view.Scale/FT
    minimum_run=number(config['minimum'],.1,50)/FT
    dimension_type=dimension_types[config['style']]
    warnings=[];directions={};points=[];geometries=[]
    class LocalView:
        native_view=None
        def __init__(self):
            inverse=transform.Inverse
            self.Origin=inverse.OfPoint(view.Origin)
            self.ViewDirection=inverse.OfVector(view.ViewDirection).Normalize()
            self.RightDirection=inverse.OfVector(view.RightDirection).Normalize()
            self.UpDirection=inverse.OfVector(view.UpDirection).Normalize()
    local=LocalView() if link else view
    for wall in walls:
        try:
            curve=wall.Location.Curve
            if not isinstance(curve,DB.Line):raise ValueError('parede curva não suportada')
            a,b=[transform.OfPoint(curve.GetEndPoint(i)) for i in (0,1)]
            delta=b.Subtract(a).Normalize()
            if abs(delta.Z)>.000001:raise ValueError('eixo fora do plano da planta')
            angle=math.atan2(delta.DotProduct(view.UpDirection),delta.DotProduct(view.RightDirection))%math.pi
            key=round(angle,7)
            directions[key]=view.RightDirection.Multiply(math.cos(angle)).Add(view.UpDirection.Multiply(math.sin(angle)))
            points.extend([a,b])
            faces=faces_of(wall,local)
            geometries.append((wall,curve,faces))
        except Exception as error:warnings.append('Parede {}: {}'.format(wall.Id.Value,error))
    if not geometries:raise ValueError('Nenhuma parede reta referenciável.')
    existing=set()
    for dim in DB.FilteredElementCollector(doc,view.Id).OfClass(DB.Dimension):
        try:existing.add(reference_key(doc,list(dim.References)))
        except Exception:pass
    group=DB.TransactionGroup(doc,'LAC · Dynamo · Cotas gerais');group.Start()
    created=[];skipped=0
    try:
        if config['mode']=='Todas as paredes':
            centre=DB.XYZ(sum(p.X for p in points)/len(points),sum(p.Y for p in points)/len(points),sum(p.Z for p in points)/len(points))
            occupied=[]
            for wall,curve,faces in geometries:
                footprint=wall_footprint(wall,local)
                if footprint:
                    world=[]
                    for x,y in footprint:
                        p=local.RightDirection.Multiply(x).Add(local.UpDirection.Multiply(y))
                        p=transform.OfPoint(p)
                        world.append((p.DotProduct(view.RightDirection),p.DotProduct(view.UpDirection)))
                    occupied.append(world)
            for dim in DB.FilteredElementCollector(doc,view.Id).OfClass(DB.Dimension):
                box=dim.get_BoundingBox(view)
                if box:occupied.append(polygon_of_box(box_rectangle(box,view)))
            for wall,curve,faces in geometries:
                try:specs,errors=dimension_specs(wall,local,'Comprimento',offset)
                except Exception as error:
                    warnings.append('Parede {}: {}'.format(wall.Id.Value,error));continue
                warnings.extend('Parede {}: {}'.format(wall.Id.Value,e) for e in errors)
                accepted=False
                for kind,refs,p,q,away,distance in specs:
                    try:
                        if link:refs=[r.CreateLinkReference(link) for r in refs]
                        key=reference_key(doc,refs)
                    except Exception:continue
                    if key in existing:skipped+=1;accepted=True;break
                    p=project_to_view(transform.OfPoint(p),view);q=project_to_view(transform.OfPoint(q),view)
                    away=transform.OfVector(away).Normalize()
                    if away.DotProduct(p.Add(q).Multiply(.5).Subtract(centre))<0:away=away.Negate()
                    for lane in range(8):
                        shift=away.Multiply(distance+lane*offset)
                        a,b=p.Add(shift),q.Add(shift)
                        if not within_crop(a,b):continue
                        area=polygon_of_box(rectangle([a,b],view,offset*.25))
                        if any(overlaps(area,box) for box in occupied):continue
                        tx=DB.Transaction(doc,'Cota associativa de parede');tx.Start()
                        try:
                            array=DB.ReferenceArray()
                            for ref in refs:array.Append(ref)
                            line=DB.Line.CreateBound(a,b)
                            dim=doc.Create.NewDimension(view,line,array,dimension_type) if dimension_type else doc.Create.NewDimension(view,line,array)
                            doc.Regenerate()
                            if dim is None or not dim.AreReferencesAvailable or dim.Value is None or abs(dim.Value-p.DistanceTo(q))>.001/FT:
                                raise ValueError('Referência não mede o comprimento proposto.')
                            if tx.Commit()!=DB.TransactionStatus.Committed:raise ValueError('Transação não confirmada.')
                            created.append(int(dim.Id.Value));existing.add(key);occupied.append(area);accepted=True;break
                        except Exception:
                            if tx.GetStatus()==DB.TransactionStatus.Started:tx.RollBack()
                        finally:tx.Dispose()
                    if accepted:break
                if not accepted:warnings.append('Parede {}: sem referências aceitas ou sem espaço livre nas 8 faixas próximas.'.format(wall.Id.Value))
            directions={}
        for angle,direction in sorted(directions.items()):
            normal=view.ViewDirection.CrossProduct(direction).Normalize();candidates=[]
            def add(ref,point,priority):
                try:
                    if ref is None:return
                    converted=ref.CreateLinkReference(link) if link else ref
                    converted.ConvertToStableRepresentation(doc)
                    world=transform.OfPoint(point)
                    candidates.append((world.DotProduct(direction),priority,converted))
                except Exception:pass
            for wall,curve,faces in geometries:
                for face in faces:
                    if abs(transform.OfVector(face.FaceNormal).DotProduct(direction))>=ALIGNMENT:
                        add(face.Reference,face.Origin,0)
                axis=curve.GetEndPoint(1).Subtract(curve.GetEndPoint(0)).Normalize()
                if abs(transform.OfVector(axis).DotProduct(direction))>=ALIGNMENT:
                    alternatives=endpoint_candidates(wall,local,curve,curve.GetEndPoint(0),curve.GetEndPoint(1),axis,faces)
                    for refs,p,q in alternatives:
                        for ref,point in zip(refs,(p,q)):add(ref,point,1)
            candidates.sort(key=lambda item:(item[0],item[1]))
            stations=[]
            for item in candidates:
                if not stations or abs(item[0]-stations[-1][0][0])>.001/FT:stations.append([item])
                else:stations[-1].append(item)
            if len(stations)<2:
                warnings.append('Direção {:.1f}°: sem duas referências externas válidas.'.format(math.degrees(angle)));continue
            # Retain both extrema; intermediate stations only at meaningful spacing.
            major=[stations[0]]
            for station in stations[1:-1]:
                if station[0][0]-major[-1][0][0]>=minimum_run and stations[-1][0][0]-station[0][0]>=minimum_run:
                    major.append(station)
            stations=major+[stations[-1]]
            minimum=min(p.DotProduct(normal) for p in points)-max(w.Width for w,_,_ in geometries)/2
            # Separate lanes outside the entire selected assembly.
            modes=['encadeada','geral'] if len(stations)>2 else ['geral']
            for lane,mode in enumerate(modes):
                selected_stations=stations if mode=='encadeada' else [stations[0],stations[-1]]
                success=False;failures=[]
                for attempt in range(6):
                    chosen=[station[min(attempt,len(station)-1)] for station in selected_stations]
                    refs=[s[2] for s in chosen];key=reference_key(doc,refs)
                    if key in existing:skipped+=1;success=True;break
                    p=view.Origin.Add(direction.Multiply(chosen[0][0]-view.Origin.DotProduct(direction))).Add(normal.Multiply(minimum-view.Origin.DotProduct(normal)-(lane+1)*offset))
                    q=p.Add(direction.Multiply(chosen[-1][0]-chosen[0][0]))
                    if not within_crop(p,q):
                        failures.append('cota fora do recorte; amplie/desative o recorte da planta');continue
                    tx=DB.Transaction(doc,'Cota geral associativa');tx.Start()
                    try:
                        array=DB.ReferenceArray()
                        for ref in refs:array.Append(ref)
                        line=DB.Line.CreateBound(p,q)
                        dim=doc.Create.NewDimension(view,line,array,dimension_type) if dimension_type else doc.Create.NewDimension(view,line,array)
                        doc.Regenerate()
                        if dim is None or not dim.AreReferencesAvailable:raise ValueError('referências rejeitadas')
                        measured=sum(seg.Value for seg in dim.Segments) if dim.NumberOfSegments>0 else dim.Value
                        if measured is None or abs(measured-(chosen[-1][0]-chosen[0][0]))>.001/FT:
                            raise ValueError('medida das referências difere da extensão geométrica')
                        if tx.Commit()!=DB.TransactionStatus.Committed:raise ValueError('transação não confirmada')
                        created.append(int(dim.Id.Value));existing.add(key);success=True;break
                    except Exception as error:
                        if tx.GetStatus()==DB.TransactionStatus.Started:tx.RollBack()
                        failures.append(str(error))
                    finally:tx.Dispose()
                if not success:warnings.append('{:.1f}° / {}: {}'.format(math.degrees(angle),mode,'; '.join(sorted(set(failures)))))
        if group.Assimilate()!=DB.TransactionStatus.Committed:raise ValueError('Grupo de cotas não confirmado.')
    except Exception:
        if group.GetStatus()==DB.TransactionStatus.Started:group.RollBack()
        raise
    finally:group.Dispose()
    result={'cotas_criadas':created,'já_existentes':skipped,'avisos':warnings,'origem':config['source']}
    finish('{} cotas criadas; {} existentes; {} avisos. Detalhes na saída do nó.'.format(len(created),skipped,len(warnings)))
    return result


OUT=guarded(dimension_main) if IN[0] else 'Ative Executar e clique Executar no modo Manual.'
# ----------------------------------------
