# Dynamo graph LAC_Hidrantes_Layout.dyn (Dynamo 4.0.2.3852)
# Proposta de hidrantes por caminhamento com marcadores leves; revisar antes de inserir.

executar = BoolSelector(false)  # graph input
LAC_Hidrantes_Layout = Python(IN[0]=executar)  # PythonNet3; graph output
# ---------- LAC_Hidrantes_Layout.python (637 lines) ----------
"""Shared Dynamo PythonNet3 adapter; embedded in each graph at build time."""
import math
import clr
clr.AddReference('RevitAPI')
clr.AddReference('RevitAPIUI')
clr.AddReference('RevitServices')
clr.AddReference('System.Windows.Forms')
clr.AddReference('System.Drawing')
from Autodesk.Revit import DB
from Autodesk.Revit.UI.Selection import ObjectType
from Autodesk.Revit.Exceptions import OperationCanceledException
from RevitServices.Persistence import DocumentManager
from RevitServices.Transactions import TransactionManager
from System.Windows import Forms as WF
from System.Drawing import Size, Point

doc=DocumentManager.Instance.CurrentDBDocument
uidoc=DocumentManager.Instance.CurrentUIApplication.ActiveUIDocument
view=doc.ActiveView
FT=.3048


def name_of(element):
    try:return element.Name
    except Exception:
        p=element.get_Parameter(DB.BuiltInParameter.SYMBOL_NAME_PARAM)
        return p.AsString() if p else str(element.Id.Value)


def configure(title, fields):
    form=WF.Form();form.Text=title;form.Width=620;form.Height=155+len(fields)*50
    form.StartPosition=WF.FormStartPosition.CenterScreen;form.TopMost=True
    form.FormBorderStyle=WF.FormBorderStyle.FixedDialog;form.MaximizeBox=False;form.MinimizeBox=False
    controls={}
    for index,(key,label,values,default) in enumerate(fields):
        text=WF.Label();text.Text=label;text.Location=Point(12,15+index*50);text.Size=Size(575,18)
        control=WF.ComboBox() if values is not None else WF.TextBox()
        control.Location=Point(12,34+index*50);control.Size=Size(575,25)
        if values is not None:
            control.DropDownStyle=WF.ComboBoxStyle.DropDownList
            for value in values:control.Items.Add(str(value))
            control.SelectedIndex=values.index(default) if default in values else 0
        else:control.Text=str(default)
        controls[key]=control;form.Controls.Add(text);form.Controls.Add(control)
    ok=WF.Button();ok.Text='Continuar';ok.DialogResult=WF.DialogResult.OK;ok.Location=Point(370,65+len(fields)*50)
    cancel=WF.Button();cancel.Text='Cancelar';cancel.DialogResult=WF.DialogResult.Cancel;cancel.Location=Point(475,65+len(fields)*50)
    form.Controls.Add(ok);form.Controls.Add(cancel);form.AcceptButton=ok;form.CancelButton=cancel
    try:
        if form.ShowDialog()!=WF.DialogResult.OK:raise OperationCanceledException()
        return {key:control.Text for key,control in controls.items()}
    finally:form.Dispose()


def number(text, low, high):
    value=float(text.replace(',','.'))
    if not math.isfinite(value) or not low<=value<=high:raise ValueError('Valor fora de {} a {}.'.format(low,high))
    return value


def source_options():
    result={'Projeto atual':None}
    for link in DB.FilteredElementCollector(doc).OfClass(DB.RevitLinkInstance):
        if link.GetLinkDocument() is not None and not link.IsHidden(view):
            result['{} [{}]'.format(name_of(link),link.Id.Value)]=link
    return result


def collect(source, link, category=None, klass=None):
    collector=DB.FilteredElementCollector(doc,view.Id,link.Id) if link else DB.FilteredElementCollector(doc,view.Id)
    if category is not None:collector=collector.OfCategory(category)
    if klass is not None:collector=collector.OfClass(klass)
    return list(collector.WhereElementIsNotElementType())


def require_plan():
    if doc.IsFamilyDocument or not isinstance(view,DB.ViewPlan) or view.IsTemplate or not view.GenLevel:
        raise ValueError('Abra uma planta de pavimento com nível associado.')
    if abs(view.ViewDirection.Z)<.999999:raise ValueError('Somente plantas horizontais são suportadas.')
    # End any idle Dynamo-managed transaction before native rollback groups.
    TransactionManager.Instance.ForceCloseTransaction()


def within_crop(a,b):
    if not view.CropBoxActive:return True
    box=view.CropBox
    for p in (a,b):
        local=box.Transform.Inverse.OfPoint(p)
        if not (box.Min.X<=local.X<=box.Max.X and box.Min.Y<=local.Y<=box.Max.Y):return False
    return True


def finish(message):
    WF.MessageBox.Show(message,'LAC · Dynamo')


def guarded(callback):
    try:
        require_plan()
        return callback()
    except OperationCanceledException:return {'status':'Cancelado pelo usuário; nenhuma operação pendente.'}
    except Exception as error:
        finish(str(error))
        return {'status':'Erro','mensagem':str(error)}

"""Conservative, planar routing in metres. No Revit dependencies."""
import heapq
import math


def inside(point, polygon):
    x, y = point
    hit = False
    for a, b in zip(polygon, polygon[1:] + polygon[:1]):
        cross = (b[0]-a[0])*(y-a[1])-(b[1]-a[1])*(x-a[0])
        if abs(cross) < 1e-9 and min(a[0], b[0])-1e-9 <= x <= max(a[0], b[0])+1e-9 and min(a[1], b[1])-1e-9 <= y <= max(a[1], b[1])+1e-9:
            return True
        if (a[1] > y) != (b[1] > y) and x < (b[0]-a[0])*(y-a[1])/(b[1]-a[1])+a[0]:
            hit = not hit
    return hit


def segments_cross(a, b, c, d):
    def side(p, q, r):
        return (q[0]-p[0])*(r[1]-p[1])-(q[1]-p[1])*(r[0]-p[0])
    def on(p, q, r):
        return min(p[0],q[0])-1e-9 <= r[0] <= max(p[0],q[0])+1e-9 and min(p[1],q[1])-1e-9 <= r[1] <= max(p[1],q[1])+1e-9
    s, t, u, v = side(a,b,c), side(a,b,d), side(c,d,a), side(c,d,b)
    return (s*t < 0 and u*v < 0) or any(abs(k)<1e-9 and on(p,q,r) for k,p,q,r in [(s,a,b,c),(t,a,b,d),(u,c,d,a),(v,c,d,b)])


def polygons_touch(a, b):
    if inside(a[0], b) or inside(b[0], a):
        return True
    return any(segments_cross(p,q,r,s) for p,q in zip(a,a[1:]+a[:1]) for r,s in zip(b,b[1:]+b[:1]))


def bounds(poly):
    return min(p[0] for p in poly), min(p[1] for p in poly), max(p[0] for p in poly), max(p[1] for p in poly)


def validate_contour(points):
    """Manual limits must be explicit simple polygons, never a bounding box guess."""
    polygon=[tuple(p) for p in points]
    if len(polygon)>1 and math.dist(polygon[0],polygon[-1])<.001:polygon.pop()
    if len(polygon)<3:raise ValueError('O contorno precisa de pelo menos três vértices.')
    for i,(a,b) in enumerate(zip(polygon,polygon[1:]+polygon[:1])):
        if math.dist(a,b)<.01:raise ValueError('Vértices repetidos/próximos demais no contorno.')
        for j,(c,d) in enumerate(zip(polygon,polygon[1:]+polygon[:1])):
            if j<=i or j==i+1 or (i==0 and j==len(polygon)-1):continue
            if segments_cross(a,b,c,d):raise ValueError('Contorno cruzado; clique os vértices na ordem do perímetro.')
    area=abs(sum(a[0]*b[1]-a[1]*b[0] for a,b in zip(polygon,polygon[1:]+polygon[:1])))/2
    if area<.1:raise ValueError('Contorno sem área útil suficiente.')
    return polygon


def make_grid(regions, obstacles, step=.25, max_cells=100000):
    """A cell is usable only when its entire square is inside the region union.

    Boundary intersection events partition every cell edge, so a thin obstacle
    cannot disappear between samples. Obstacles are conservatively rasterized.
    """
    if not regions or not .1 <= step <= 1:
        raise ValueError('Sem áreas de circulação ou resolução fora de 0,10–1,00 m.')
    all_points = [p for poly in regions for p in poly]
    box = bounds(all_points)
    origin = (math.floor(box[0]/step)*step, math.floor(box[1]/step)*step)
    nx, ny = int(math.ceil((box[2]-origin[0])/step)), int(math.ceil((box[3]-origin[1])/step))
    if nx*ny > max_cells:
        raise ValueError('Área muito grande: limite de {} células. Restrinja o pavimento/áreas.'.format(max_cells))
    index = {}
    for kind, polygons in [('r',regions),('o',obstacles)]:
        for poly in polygons:
            x0,y0,x1,y1=bounds(poly)
            for i in range(max(0,int(math.floor((x0-origin[0])/step))-1), min(nx,int(math.ceil((x1-origin[0])/step))+1)):
                for j in range(max(0,int(math.floor((y0-origin[1])/step))-1), min(ny,int(math.ceil((y1-origin[1])/step))+1)):
                    index.setdefault((i,j), {'r':[], 'o':[]})[kind].append(poly)
    cells = set()
    for cell, nearby in index.items():
        i,j=cell; x,y=origin[0]+i*step,origin[1]+j*step
        square=[(x,y),(x+step,y),(x+step,y+step),(x,y+step)]
        samples=square+[(x+step/2,y+step/2)]
        covered=bool(nearby['r']) and all(any(inside(p,poly) for poly in nearby['r']) for p in samples)
        if not covered or any(polygons_touch(square,poly) for poly in nearby['o']):
            continue
        # Cover each boundary interval; do not bridge gaps between rooms.
        for a,b in zip(square,square[1:]+square[:1]):
            ts=[0.,1.];dx,dy=b[0]-a[0],b[1]-a[1]
            for poly in nearby['r']:
                for c,d in zip(poly,poly[1:]+poly[:1]):
                    ex,ey=d[0]-c[0],d[1]-c[1];det=dx*ey-dy*ex
                    if abs(det)<1e-12:continue
                    t=((c[0]-a[0])*ey-(c[1]-a[1])*ex)/det
                    u=((c[0]-a[0])*dy-(c[1]-a[1])*dx)/det
                    if 0<t<1 and 0<=u<=1:ts.append(t)
            ts=sorted(ts)
            if any(not any(inside((a[0]+dx*(lo+hi)/2,a[1]+dy*(lo+hi)/2),poly) for poly in nearby['r']) for lo,hi in zip(ts,ts[1:])):
                covered=False;break
        if covered:cells.add(cell)
    return {'cells':cells,'origin':origin,'step':step}


def coordinate(grid, cell):
    return tuple(grid['origin'][k]+(cell[k]+.5)*grid['step'] for k in (0,1))


def nearest(grid, point, max_distance=1.):
    if not grid['cells']:raise ValueError('Nenhuma célula transitável.')
    cell=min(grid['cells'],key=lambda c:math.dist(coordinate(grid,c),point))
    if math.dist(coordinate(grid,cell),point)>max_distance:
        raise ValueError('Ponto fora da área transitável; selecione pelo lado interno da entrada.')
    return cell


def distances(grid, start, limit=float('inf')):
    costs={start:0.};parents={};queue=[(0.,start)]
    while queue:
        cost,cell=heapq.heappop(queue)
        if cost!=costs[cell]:continue
        for dx,dy in [(1,0),(-1,0),(0,1),(0,-1),(1,1),(-1,1),(1,-1),(-1,-1)]:
            nxt=(cell[0]+dx,cell[1]+dy)
            if nxt not in grid['cells']:continue
            if dx and dy and ((cell[0]+dx,cell[1]) not in grid['cells'] or (cell[0],cell[1]+dy) not in grid['cells']):continue
            value=cost+grid['step']*math.hypot(dx,dy)
            if value<=limit and value<costs.get(nxt,float('inf')):
                costs[nxt]=value;parents[nxt]=cell;heapq.heappush(queue,(value,nxt))
    return costs,parents


def distribute(grid, entry, candidates, reach=30., max_hydrants=40, progress=None, reserve=0.):
    if reach<=grid['step']*2:raise ValueError('Alcance insuficiente para a resolução.')
    reachable,_=distances(grid,entry)
    candidates=list(dict.fromkeys(c for c in candidates if c in reachable))
    if not candidates:raise ValueError('Sem posições candidatas acessíveis junto às paredes.')
    # Coverage includes the farthest point of the square, not just its centre.
    usable=reach-grid['step']*math.sqrt(2)/2-reserve
    if usable<=0:raise ValueError('Reserva de instalação excede o alcance disponível.')
    first=min(candidates,key=lambda c:reachable[c])
    coverage={};budget=0
    for index,candidate in enumerate(candidates):
        if progress:progress(index,len(candidates))
        costs,_=distances(grid,candidate,usable)
        coverage[candidate]=set(costs);budget+=len(costs)
        if budget>2000000:raise ValueError('Cobertura excede limite de memória. Restrinja as áreas analisadas.')
    chosen=[];uncovered=set(reachable);routes=[];counts=[]
    while uncovered and len(chosen)<max_hydrants:
        if not chosen:best=first
        else:
            best=None;score=0
            for candidate in candidates:
                if candidate in chosen:continue
                count=len(uncovered.intersection(coverage[candidate]))
                if count>score:score=count;best=candidate
            if best is None:break
        costs,parents=distances(grid,best,usable)
        served=uncovered.intersection(costs)
        if not served:break
        farthest=max(served,key=lambda c:costs[c]);path=[farthest]
        while path[-1]!=best:path.append(parents[path[-1]])
        routes.append(list(reversed(path)));counts.append(len(served))
        chosen.append(best);uncovered.difference_update(served)
    return {'positions':chosen,'routes':routes,'served_cells':counts,'uncovered':uncovered,
            'disconnected':grid['cells'].difference(reachable),'analyzed':len(grid['cells']),
            'reachable':len(reachable),'sampling':'grade conservadora; não inclui faixas descartadas junto às bordas'}

"""Lightweight model references. No RFA loading or family regeneration."""
import math
MARKER_APP='LAC.Dynamo.HydrantProposal.v1'


def is_hydrant_marker(element):
    return getattr(element,'ApplicationId',None)==MARKER_APP


def next_marker_label(used):
    index=1
    while 'H-P{:03d}'.format(index) in used:index+=1
    return 'H-P{:03d}'.format(index)


def marker_context(level,phase):
    return '{}|{}|'.format(level,phase)


def marker_matches(element,context,point):
    if not is_hydrant_marker(element) or not element.ApplicationDataId.startswith(context):return False
    box=element.get_BoundingBox(None)
    if box is None:return False
    centre=box.Transform.OfPoint(box.Min.Add(box.Max).Multiply(.5))
    # User-moved markers are compared at their current geometry location.
    return math.hypot(centre.X-point.X,centre.Y-point.Y)<=.5/FT


def create_hydrant_marker(point,label,context,phase_id):
    from System.Collections.Generic import List
    half=.08/FT
    # A small square post crosses the usual plan cut plane. Its dimensions
    # are merely graphical references, never actual hydrant dimensions.
    base=DB.XYZ(point.X,point.Y,point.Z+.02/FT)
    corners=[base.Add(DB.XYZ(x*half,y*half,0)) for x,y in [(-1,-1),(1,-1),(1,1),(-1,1)]]
    loop=DB.CurveLoop()
    for a,b in zip(corners,corners[1:]+corners[:1]):loop.Append(DB.Line.CreateBound(a,b))
    loops=List[DB.CurveLoop]();loops.Add(loop)
    solid=DB.GeometryCreationUtilities.CreateExtrusionGeometry(loops,DB.XYZ.BasisZ,1.5/FT)
    geometry=List[DB.GeometryObject]();geometry.Add(solid)
    element=DB.DirectShape.CreateElement(doc,DB.ElementId(DB.BuiltInCategory.OST_GenericModel))
    element.ApplicationId=MARKER_APP;element.ApplicationDataId=context+label
    element.Name=label+' · Hidrante proposto LAC'
    element.SetShape(geometry)
    if element.ArePhasesModifiable() and phase_id!=DB.ElementId.InvalidElementId:
        element.CreatedPhaseId=phase_id
    for parameter,value in [(DB.BuiltInParameter.ALL_MODEL_MARK,label),
            (DB.BuiltInParameter.ALL_MODEL_INSTANCE_COMMENTS,'Posição sugerida de hidrante. Marcador genérico de estudo; revisar e posicionar a família definitiva. Não representa equipamento instalado.')]:
        p=element.get_Parameter(parameter)
        if p and not p.IsReadOnly:p.Set(value)
    # Per-element graphics: a visible blue reference, without new materials.
    graphics=DB.OverrideGraphicSettings()
    color=DB.Color(0,135,255)
    graphics.SetProjectionLineColor(color);graphics.SetCutLineColor(color)
    graphics.SetProjectionLineWeight(5);graphics.SetCutLineWeight(5)
    doc.ActiveView.SetElementOverrides(element.Id,graphics)
    return element


def insert_hydrant_markers(result,level,z,summary):
    if WF.MessageBox.Show(summary+'\n\nCriar marcadores genéricos leves no Revit? Não exige família de hidrante.',
            'Marcar posições propostas',WF.MessageBoxButtons.OKCancel)!=WF.DialogResult.OK:return result
    markers=[element for element in DB.FilteredElementCollector(doc).OfClass(DB.DirectShape) if is_hydrant_marker(element)]
    phase_parameter=view.get_Parameter(DB.BuiltInParameter.VIEW_PHASE)
    phase_id=phase_parameter.AsElementId() if phase_parameter else DB.ElementId.InvalidElementId
    context=marker_context(level.UniqueId,phase_id.Value)
    used={element.ApplicationDataId.rsplit('|',1)[-1] for element in markers}
    result['marcadores_existentes']=[];result['identificações_criadas']=[]
    transaction=DB.Transaction(doc,'LAC · Dynamo · Marcadores de hidrante');transaction.Start()
    try:
        for x,y in result['posições_m']:
            point=DB.XYZ(x/FT,y/FT,z)
            existing=next((element for element in markers if marker_matches(element,context,point)),None)
            if existing is not None:
                result['marcadores_existentes'].append(int(existing.Id.Value));continue
            label=next_marker_label(used)
            element=create_hydrant_marker(point,label,context,phase_id)
            markers.append(element);used.add(label)
            result['elementos_criados'].append(int(element.Id.Value));result['identificações_criadas'].append(label)
        if transaction.Commit()!=DB.TransactionStatus.Committed:raise ValueError('Revit não confirmou os marcadores.')
    except Exception:
        if transaction.GetStatus()==DB.TransactionStatus.Started:transaction.RollBack()
        raise
    finally:transaction.Dispose()
    result['modo']='Marcadores genéricos leves; sem família de hidrante'
    finish('{} marcadores criados; {} já existentes. Categoria: Modelos genéricos.\nIdentificação H-P001, H-P002… nos parâmetros Marca e Nome. Use as posições como referência para colocar as famílias definitivas.'.format(len(result['elementos_criados']),len(result['marcadores_existentes'])))
    return result

"""Planar layout proposal. Not a hydraulic design or regulatory certification."""
def hydrant_main():
    sources=source_options()
    initial=configure('Hidrantes · origem do layout',[
        ('source','Modelo arquitetônico',list(sources),'Projeto atual'),
        ('area','Área a analisar',['Ambientes do modelo','Contorno por pontos (sem ambientes)'],'Ambientes do modelo'),
        ('reach','Alcance máximo por caminhamento (m)',None,'30'),
        ('step','Resolução da análise (m) — menor = mais detalhado',None,'0,25'),
        ('furniture','Considerar móveis e equipamentos como obstáculos',['Sim','Não'],'Sim'),
    ])
    link=sources[initial['source']];source=link.GetLinkDocument() if link else doc
    transform=link.GetTotalTransform() if link else DB.Transform.Identity
    reach=number(initial['reach'],1,60);step=number(initial['step'],.1,.5)
    phases={'{} [{}]'.format(name_of(p),p.Id.Value):p for p in source.Phases}
    current_phase_parameter=view.get_Parameter(DB.BuiltInParameter.VIEW_PHASE)
    current_phase=doc.GetElement(current_phase_parameter.AsElementId()) if current_phase_parameter else None
    default_phase=next((label for label,item in phases.items() if current_phase and name_of(item)==name_of(current_phase)),list(phases)[-1])
    config=configure('Hidrantes · pavimento e fase',[
        ('phase','Fase arquitetônica (usada no modo Ambientes)',list(phases),default_phase),
        ('review','Resultado',['Marcadores genéricos leves no Revit','Somente proposta (sem criar elementos)','Proposta e inserir família após confirmação'],'Marcadores genéricos leves no Revit'),
    ])
    phase=phases[config['phase']];level=view.GenLevel;z=level.ProjectElevation
    rooms=[];regions=[];holes=[];warnings=[];ignored=[]
    manual=initial['area']=='Contorno por pontos (sem ambientes)'
    # Rooms are selected by source phase and transformed elevation, not host IDs.
    options=DB.SpatialElementBoundaryOptions()
    all_rooms=list(DB.FilteredElementCollector(source).OfCategory(DB.BuiltInCategory.OST_Rooms).WhereElementIsNotElementType()) if not manual else []
    diagnostics={'total_no_modelo':len(all_rooms),'sem_area_ou_posição':0,'outra_fase':0,'outro_nível':0,'não_lidos':0}
    for room in all_rooms:
        try:
            if room.Area<=0 or room.Location is None:
                diagnostics['sem_area_ou_posição']+=1;continue
            if room.Phase.Id!=phase.Id:
                diagnostics['outra_fase']+=1;continue
            room_level=source.GetElement(room.LevelId)
            # Room insertion offsets do not determine which floor it belongs to.
            if room_level is None or abs(transform.OfPoint(DB.XYZ(0,0,room_level.ProjectElevation)).Z-z)>.5/FT:
                diagnostics['outro_nível']+=1;continue
            loops=room.GetBoundarySegments(options)
            if not loops:ignored.append(int(room.Id.Value));continue
            polygons=[]
            for loop in loops:
                points=[]
                for segment in loop:
                    points.extend([(transform.OfPoint(p).X*FT,transform.OfPoint(p).Y*FT) for p in list(segment.GetCurve().Tessellate())[:-1]])
                if len(points)>=3:polygons.append(points)
            # Revit's first loop is normally external; use largest area explicitly.
            polygons.sort(key=lambda poly:abs(sum(a[0]*b[1]-a[1]*b[0] for a,b in zip(poly,poly[1:]+poly[:1]))),reverse=True)
            if polygons and view.CropBoxActive:
                crop=view.CropBox
                for x,y in polygons[0]:
                    p=crop.Transform.Inverse.OfPoint(DB.XYZ(x/FT,y/FT,z))
                    if not (crop.Min.X<=p.X<=crop.Max.X and crop.Min.Y<=p.Y<=crop.Max.Y):
                        raise ValueError('ambiente cortado/fora do recorte da planta; desative o recorte para analisar o pavimento inteiro')
            if polygons:regions.append(polygons[0]);holes.extend(polygons[1:]);rooms.append(room)
        except Exception as error:
            diagnostics['não_lidos']+=1
            ignored.append(int(room.Id.Value));warnings.append('Ambiente {}: {}'.format(room.Id.Value,error))
    options.Dispose()
    if not regions and not manual:
        message='Nenhum ambiente delimitado disponível.\nOrigem: {}\nFase: {}\nNível da planta: {}\nAmbientes no modelo: {}; sem área/posição: {}; outra fase: {}; outro nível: {}; falhas: {}.\n\nSe o arquitetônico está em vínculo, confira a origem escolhida.\nDeseja definir a área por pontos, sem criar ambientes?'.format(initial['source'],config['phase'],name_of(level),len(all_rooms),diagnostics['sem_area_ou_posição'],diagnostics['outra_fase'],diagnostics['outro_nível'],diagnostics['não_lidos'])
        if warnings:message+='\nPrimeiro aviso: '+warnings[0]
        if WF.MessageBox.Show(message,'Definir área de análise',WF.MessageBoxButtons.YesNo)!=WF.DialogResult.Yes:
            return {'status':'Sem área de análise; confira origem/fase/nível ou use contorno por pontos.','diagnóstico_ambientes':diagnostics,'avisos':warnings}
        manual=True
    if manual:
        limits=configure('Contorno da área de análise',[
            ('vertices','Quantidade de vértices do contorno externo',None,'4'),
            ('holes','Quantidade de pátios/vãos internos a excluir',None,'0'),
        ])
        vertex_count=number(limits['vertices'],3,80);hole_count=number(limits['holes'],0,20)
        if not vertex_count.is_integer() or not hole_count.is_integer():raise ValueError('As quantidades de vértices e vãos devem ser inteiras.')
        def pick_contour(count,label):
            points=[]
            for i in range(count):
                point=uidoc.Selection.PickPoint('{}: vértice {}/{} — siga a ordem do perímetro; Esc cancela'.format(label,i+1,count))
                plane_point=DB.XYZ(point.X,point.Y,z)
                if not within_crop(plane_point,plane_point):raise ValueError('Contorno fora do recorte da planta. Amplie/desative o recorte para incluir os obstáculos da área selecionada.')
                points.append((point.X*FT,point.Y*FT))
            return validate_contour(points)
        finish('Clique os vértices do limite real da área, em ordem. O fechamento entre o último e o primeiro será automático. Exclua pátios/vãos sem piso. As paredes e portas da origem escolhida continuam sendo usadas como obstáculos/passagens.')
        regions=[pick_contour(int(vertex_count),'Contorno externo')];holes=[]
        for index in range(int(hole_count)):
            options_hole=configure('Vão/pátio {}'.format(index+1),[('vertices','Quantidade de vértices',None,'4')])
            count=number(options_hole['vertices'],3,80)
            if not count.is_integer():raise ValueError('Quantidade de vértices deve ser inteira.')
            poly=pick_contour(int(count),'Vão/pátio {}'.format(index+1))
            if not all(inside(p,regions[0]) for p in poly):raise ValueError('O vão/pátio deve ficar dentro do contorno externo.')
            holes.append(poly)
        if ignored:warnings.append('Leitura de ambientes substituída pelo contorno manual; revise o limite selecionado.')
        ignored=[]
    analysis_boundaries=list(regions)
    def point2(p):
        p=transform.OfPoint(p);return p.X*FT,p.Y*FT
    def box_polygon(element):
        if is_hydrant_marker(element):return None
        box=element.get_BoundingBox(None)
        if box is None:return None
        corners=[transform.OfPoint(box.Transform.OfPoint(DB.XYZ(x,y,v))) for x in (box.Min.X,box.Max.X) for y in (box.Min.Y,box.Max.Y) for v in (box.Min.Z,box.Max.Z)]
        if max(p.Z for p in corners)<z+.15/FT or min(p.Z for p in corners)>z+1.5/FT:return None
        # Rotated boxes are deliberately conservative in the host XY plane.
        a,b,c,d=min(p.X for p in corners)*FT,min(p.Y for p in corners)*FT,max(p.X for p in corners)*FT,max(p.Y for p in corners)*FT
        return [(a,b),(c,b),(c,d),(a,d)]
    doors=collect(source,link,category=DB.BuiltInCategory.OST_Doors)
    walls=collect(source,link,klass=DB.Wall)
    obstacles=list(holes);candidates=[];wall_positions=[]
    def width_of(door):
        for element in (door,source.GetElement(door.GetTypeId())):
            p=element.get_Parameter(DB.BuiltInParameter.DOOR_WIDTH) if element else None
            if p and p.AsDouble()>0:return p.AsDouble()*FT
        return None
    for wall in walls:
        try:
            curve=wall.Location.Curve
            if not isinstance(curve,DB.Line):
                poly=box_polygon(wall)
                if poly:obstacles.append(poly)
                warnings.append('Parede curva {}: caixa conservadora; não recebe hidrante.'.format(wall.Id.Value));continue
            box=wall.get_BoundingBox(None)
            if box is None:continue
            low=transform.OfPoint(box.Transform.OfPoint(box.Min)).Z;high=transform.OfPoint(box.Transform.OfPoint(box.Max)).Z
            if max(low,high)<z+.15/FT or min(low,high)>z+1.5/FT:continue
            a,b=point2(curve.GetEndPoint(0)),point2(curve.GetEndPoint(1))
            length=math.dist(a,b)
            if length<.01:continue
            d=((b[0]-a[0])/length,(b[1]-a[1])/length);n=(-d[1],d[0]);half=wall.Width*FT/2
            side_offsets=[]
            for shell in (DB.ShellLayerType.Interior,DB.ShellLayerType.Exterior):
                offsets=[]
                for reference in DB.HostObjectUtils.GetSideFaces(wall,shell):
                    face=wall.GetGeometryObjectFromReference(reference)
                    if isinstance(face,DB.PlanarFace):
                        pos=point2(face.Origin);offsets.append((pos[0]-a[0])*n[0]+(pos[1]-a[1])*n[1])
                if offsets:side_offsets.extend(offsets)
            if len(side_offsets)<2:raise ValueError('sem faces laterais suficientes para definir a espessura real')
            wall_lo,wall_hi=min(side_offsets),max(side_offsets)
            def rect(lo,hi,low,high):
                return [(a[0]+d[0]*t+n[0]*s,a[1]+d[1]*t+n[1]*s) for t,s in [(lo,low),(hi,low),(hi,high),(lo,high)]]
            cuts=[]
            for door in doors:
                if door.Host is None or door.Host.Id!=wall.Id or not isinstance(door.Location,DB.LocationPoint):continue
                width=width_of(door)
                if width is None:
                    warnings.append('Porta {} sem largura: passagem bloqueada.'.format(door.Id.Value));continue
                # An instance at another level must never open this wall in plan.
                door_level=source.GetElement(door.LevelId)
                if door_level is None or abs(transform.OfPoint(DB.XYZ(0,0,door_level.ProjectElevation)).Z-z)>.5/FT:continue
                pos=point2(door.Location.Point);t=(pos[0]-a[0])*d[0]+(pos[1]-a[1])*d[1]
                lo,hi=max(0,t-width/2),min(length,t+width/2)
                if hi<=lo:continue
                cuts.append((lo,hi))
                # A manual perimeter is a strict limit: opening a door must not
                # grow the analysis region through the building's outer entrance.
                if not manual:regions.append(rect(lo,hi,wall_lo-step*2,wall_hi+step*2))
            cuts.sort();cursor=0.;solid=[]
            for lo,hi in cuts:
                if lo>cursor:solid.append((cursor,lo))
                cursor=max(cursor,hi)
            if cursor<length:solid.append((cursor,length))
            for lo,hi in solid:
                obstacles.append(rect(lo,hi,wall_lo,wall_hi))
                count=max(1,int((hi-lo)/3))
                for k in range(count):
                    t=lo+(hi-lo)*(k+.5)/count
                    for sign,boundary in ((-1,wall_lo),(1,wall_hi)):
                        distance=boundary+sign*step*1.5
                        p=(a[0]+d[0]*t+n[0]*distance,a[1]+d[1]*t+n[1]*distance)
                        wall_positions.append((p,wall,DB.XYZ(n[0]*sign,n[1]*sign,0)))
        except Exception as error:
            raise ValueError('Não foi possível ler a parede {}. Análise interrompida para não ignorar obstáculo: {}'.format(wall.Id.Value,error))
    categories=[DB.BuiltInCategory.OST_Columns,DB.BuiltInCategory.OST_StructuralColumns,DB.BuiltInCategory.OST_GenericModel]
    if initial['furniture']=='Sim':categories.extend([DB.BuiltInCategory.OST_Furniture,DB.BuiltInCategory.OST_SpecialityEquipment,DB.BuiltInCategory.OST_PlumbingFixtures,DB.BuiltInCategory.OST_MechanicalEquipment])
    for category in categories:
        for element in collect(source,link,category=category):
            poly=box_polygon(element)
            if poly:obstacles.append(poly)
    # Also consider PPCI host obstacles when the architecture is linked.
    if link:
        saved=transform;transform=DB.Transform.Identity
        for category in categories+[DB.BuiltInCategory.OST_Walls]:
            for element in collect(doc,None,category=category):
                poly=box_polygon(element)
                if poly:obstacles.append(poly)
        transform=saved
    if ignored:warnings.append('{} ambientes não puderam ser delimitados.'.format(len(ignored)))
    grid=make_grid(regions,obstacles,step,max_cells=60000)
    finish('Clique no lado interno da entrada principal. A proposta considera os ambientes da fase escolhida e os obstáculos visíveis da planta. Elementos ocultos e áreas sem ambientes precisam de revisão.')
    entrance=uidoc.Selection.PickPoint('Clique no lado interno da entrada principal')
    entry=nearest(grid,(entrance.X*FT,entrance.Y*FT),max_distance=step*2)
    for p,wall,n in wall_positions:
        try:
            cell=nearest(grid,p,max_distance=step*.72)
            if cell not in [item[0] for item in candidates]:candidates.append((cell,wall,n))
        except ValueError:pass
    # Deterministic spread over the layout; never silently reduce resolution.
    if len(candidates)>80:raise ValueError('Mais de 80 posições candidatas: restrinja a vista/ambientes antes de executar.')
    status=WF.Form();status.Text='Calculando cobertura · feche para cancelar';status.Size=Size(460,110);status.TopMost=True
    label=WF.Label();label.Size=Size(430,45);label.Location=Point(10,10);status.Controls.Add(label);status.Show()
    def progress(index,total):
        if status.IsDisposed:raise OperationCanceledException()
        label.Text='Posição {}/{} — calculando percursos no layout'.format(index+1,total)
        WF.Application.DoEvents()
    reserve=step*2.3+max([wall.Width*FT for wall in walls] or [0])
    try:result=distribute(grid,entry,[item[0] for item in candidates],reach,progress=progress,reserve=reserve)
    finally:
        if not status.IsDisposed:status.Close();status.Dispose()
    bycell={cell:(wall,n) for cell,wall,n in candidates}
    result['avisos']=warnings
    result['posições_m']=[coordinate(grid,c) for c in result['positions']]
    result['rotas_m']=[[coordinate(grid,c) for c in route] for route in result['routes']]
    result['limite_m']=reach;result['resolução_m']=step;result['fase']=config['phase'];result['elementos_criados']=[]
    result['projeto']=doc.Title;result['endereço_projeto']=doc.ProjectInformation.Address
    result['área_de_análise']='Contorno por pontos' if manual else 'Ambientes do modelo'
    result['diagnóstico_ambientes']=diagnostics;result['contornos_m']=analysis_boundaries;result['exclusões_m']=holes
    result['reserva_instalação_m']=reserve
    result['uncovered']=sorted(result['uncovered']);result['disconnected']=sorted(result['disconnected'])
    result['faixas_de_borda']='Faixas menores que a resolução e células junto aos obstáculos não são certificadas por esta amostragem; revisar na planta.'
    summary='{} hidrantes sugeridos; {} células sem cobertura; {} células sem conexão com a entrada.\nResolução: {} m. Revisar faixas de borda e passagens estreitas descartadas na grade.\nProposta geométrica; não verifica vazão, pressão, tubulação, simultaneidade ou aprovação normativa.'.format(len(result['positions']),len(result['uncovered']),len(result['disconnected']),step)
    # Dynamo preview, using the same coordinate units conversion as Revit geometry.
    clr.AddReference('RevitNodes');import Revit
    clr.AddReference('ProtoGeometry')
    from Autodesk.DesignScript.Geometry import Line as DSLine
    clr.ImportExtensions(Revit.GeometryConversion)
    preview_points=[DB.XYZ(x/FT,y/FT,z).ToPoint() for x,y in result['posições_m']]
    result['prévia_pontos']=preview_points
    route_points=[[DB.XYZ(x/FT,y/FT,z).ToPoint() for x,y in route] for route in result['rotas_m']]
    result['prévia_rotas']=[[DSLine.ByStartPointEndPoint(a,b) for a,b in zip(points,points[1:])] for points in route_points]
    result['prévia_contornos']=[[DSLine.ByStartPointEndPoint(DB.XYZ(a[0]/FT,a[1]/FT,z).ToPoint(),DB.XYZ(b[0]/FT,b[1]/FT,z).ToPoint()) for a,b in zip(poly,poly[1:]+poly[:1])] for poly in analysis_boundaries+holes]
    if config['review']=='Somente proposta (sem criar elementos)':
        finish(summary+'\nConsulte a prévia e a saída do nó.');return result
    if result['uncovered'] or result['disconnected'] or ignored:
        finish(summary+'\nInserção bloqueada: confira áreas não atendidas/ambientes não lidos.');return result
    if config['review']=='Marcadores genéricos leves no Revit':
        return insert_hydrant_markers(result,level,z,summary)
    types={}
    for symbol in DB.FilteredElementCollector(doc).OfClass(DB.FamilySymbol):
        # User chooses the actual loaded hydrant type; no guessed family names.
        if symbol.Family.FamilyPlacementType in (DB.FamilyPlacementType.OneLevelBased,DB.FamilyPlacementType.OneLevelBasedHosted):
            if not link or symbol.Family.FamilyPlacementType==DB.FamilyPlacementType.OneLevelBased:
                types['{} · {} [{}]'.format(symbol.FamilyName,name_of(symbol),symbol.Id.Value)]=symbol
    if not types:raise ValueError('Carregue uma família de hidrante baseada em nível. No modelo próprio também são aceitas famílias hospedadas em parede. Famílias de face exigem adaptação específica.')
    placement=configure('Inserir proposta revisada',[
        ('type','Tipo de hidrante carregado no projeto',list(types),list(types)[0]),
        ('height','Altura de inserção acima do nível (m)',None,'1,20'),
    ])
    height=number(placement['height'],0,3);symbol=types[placement['type']]
    if WF.MessageBox.Show(summary+'\n\nConfirma inserir a proposta revisada com o tipo escolhido?', 'Inserir hidrantes',WF.MessageBoxButtons.OKCancel)!=WF.DialogResult.OK:return result
    existing=list(DB.FilteredElementCollector(doc).OfClass(DB.FamilyInstance).WhereElementIsNotElementType())
    group=DB.TransactionGroup(doc,'LAC · Dynamo · Hidrantes');group.Start()
    try:
        tx=DB.Transaction(doc,'Inserir hidrantes');tx.Start()
        try:
            if not symbol.IsActive:symbol.Activate();doc.Regenerate()
            for cell in result['positions']:
                x,y=coordinate(grid,cell);point=DB.XYZ(x/FT,y/FT,z+height/FT)
                wall,n=bycell[cell]
                if symbol.Family.FamilyPlacementType==DB.FamilyPlacementType.OneLevelBasedHosted:
                    # Move the preview point to the actual host axis; do not host on a linked wall.
                    local=wall.Location.Curve.Project(DB.XYZ(point.X,point.Y,wall.Location.Curve.GetEndPoint(0).Z))
                    if local is None:raise ValueError('Não foi possível projetar hidrante no hospedeiro.')
                    point=DB.XYZ(local.XYZPoint.X,local.XYZPoint.Y,point.Z)
                    if any(e.GetTypeId()==symbol.Id and isinstance(e.Location,DB.LocationPoint) and e.Location.Point.DistanceTo(point)<.5/FT for e in existing):continue
                    instance=doc.Create.NewFamilyInstance(point,symbol,wall,level,DB.Structure.StructuralType.NonStructural)
                else:
                    if any(e.GetTypeId()==symbol.Id and isinstance(e.Location,DB.LocationPoint) and e.Location.Point.DistanceTo(point)<.5/FT for e in existing):continue
                    instance=doc.Create.NewFamilyInstance(point,symbol,level,DB.Structure.StructuralType.NonStructural)
                facing=instance.FacingOrientation
                angle=math.atan2(facing.X*n.Y-facing.Y*n.X,facing.X*n.X+facing.Y*n.Y)
                DB.ElementTransformUtils.RotateElement(doc,instance.Id,DB.Line.CreateBound(point,point.Add(DB.XYZ.BasisZ)),angle)
                existing.append(instance);result['elementos_criados'].append(int(instance.Id.Value))
            if tx.Commit()!=DB.TransactionStatus.Committed:raise ValueError('Revit não confirmou a inserção.')
        except Exception:
            if tx.GetStatus()==DB.TransactionStatus.Started:tx.RollBack()
            raise
        finally:tx.Dispose()
        if group.Assimilate()!=DB.TransactionStatus.Committed:raise ValueError('Grupo de inserção não confirmado.')
    except Exception:
        if group.GetStatus()==DB.TransactionStatus.Started:group.RollBack()
        raise
    finally:group.Dispose()
    finish(summary+'\n{} instâncias criadas.'.format(len(result['elementos_criados'])))
    return result


OUT=guarded(hydrant_main) if IN[0] else 'Ative Executar e clique Executar no modo Manual.'
# ----------------------------------------
